# Grasshopper definition IOMesh.gh (Grasshopper 1.0.7)

# Re enable this for export
c_script = CSharpScript(Reference="C:\Program Files (x86)\Reference Assemblies\Microsoft\Framework\.NETFramework\v4.8\System.Numerics.dll")  # -> graph
# ---------- c_script: C# usings ----------
using System.Linq;
using System.Numerics;
using Rhino.FileIO;
# ---------- c_script: C# ----------
    graph = new TerritoryGraph()
      {
        Run = CreateGraph(FindLinesByLayer("Run")),
        Fly = CreateGraph(FindLinesByLayer("Fly")),
        };
# ---------- c_script: C# additional code ----------
  private static double tol = 0.01;
  private static GraphDto CreateGraph(Line[] lines)
  {
    if(lines.Length == 0)
    {
      return new GraphDto()
        {
          Edges = Array.Empty<EdgeDto>(),
          Nodes = Array.Empty<Vector3>(),
          };
    }
    var option = new FileObjReadOptions(new FileReadOptions());
    option.MapYtoZ = true;

    Transform trans;
    option.GetTransform().TryGetInverse(out trans);

    var pts = Point3d.CullDuplicates(lines.Select(l => l.From).Concat(lines.Select(l => l.To)), tol);

    var edges = lines.Select(l => new EdgeDto()
      {
        Start = GetIndex(pts, l.From),
        End = GetIndex(pts, l.To),
        Velocity = 1,
        }).ToArray();

    edges = edges.Concat(edges.Select(e => new EdgeDto()
      {
        Start = e.End,
        End = e.Start,
        Velocity = e.Velocity,
        })).ToArray();

    var nodes = pts.Select(p =>
      {
      p.Transform(trans);
      return new Vector3((float) p.X, (float) p.Y, (float) p.Z);
      }).ToArray();

    return new GraphDto()
      {
        Edges = edges,
        Nodes = nodes,
        };
  }
  private static Line[] FindLinesByLayer(string layerName)
  {
    var objs = Rhino.RhinoDoc.ActiveDoc.Objects.FindByLayer(layerName)
      .Select(o => o.Geometry);

    return objs.OfType<LineCurve>().Select(l => l.Line)
      .Concat(objs.OfType<PolylineCurve>()
      .SelectMany(p => p.ToPolyline().GetSegments())).ToArray();
  }

  private static int GetIndex(Point3d[] pts, Point3d p)
  {
    double minDis = double.MaxValue;
    int index = -1;
    for (int i = 0; i < pts.Length; i++)
    {
      var dis = p.DistanceToSquared(pts[i]);
      if(dis < minDis)
      {
        minDis = dis;
        index = i;
      }
    }
    return index;
  }

  public struct GraphDto
  {
    public Vector3[] Nodes { get; set; }

    public EdgeDto[] Edges { get; set; }
  }
  public struct EdgeDto
  {
    public int Start { get; set; }
    public int End { get; set; }
    public float Velocity { get; set; }
  }
  public struct TerritoryGraph
  {
    public GraphDto Run { get; set; }
    public GraphDto Fly { get; set; }
  }
# ---------- end c_script ----------
path = FilePath("E:\Downloads\Godbert\f1t1")

# ---- group: Graph
python = GhPythonScript(x=c_script)  # -> run, fly
# ---------- python: Python ----------
run = x.Run
fly = x.Fly
# ---------- end python ----------
python_2 = GhPythonScript(x=python.fly)  # -> a, b
# ---------- python_2: Python ----------
a = x.Nodes
b = x.Edges
# ---------- end python_2 ----------
python_3 = GhPythonScript(x=python.run)  # -> a, b; same code as python_2
python_4 = GhPythonScript(x=python_2.b)  # -> a
# ---------- python_4: Python ----------
a = "Start {}, End {}".format(x.Start, x.End)
# ---------- end python_4 ----------
python_5 = GhPythonScript(x=python_3.b)  # -> a; same code as python_4
edges = Panel(python_4)
edges_2 = Panel(python_5)
nodes = Panel(python_2.a)
nodes_2 = Panel(python_3.a)

# ----
c_script_2 = CSharpScript(directory=path)  # -> filePaths; inputs directory: String
# ---------- c_script_2: C# usings ----------
using System.IO;
using System.Drawing;
using Rhino.DocObjects;
using Rhino.DocObjects.Tables;
# ---------- c_script_2: C# ----------
    filePaths = Directory.GetFiles(directory, "*.obj");

    var layers = Rhino.RhinoDoc.ActiveDoc.Layers;
    AddLayer(layers, "Run", Color.DarkGreen);
    AddLayer(layers, "Fly", Color.DarkBlue);
# ---------- c_script_2: C# additional code ----------
  private static void AddLayer(LayerTable layers, string name, Color color)
  {
    if (layers.FindName(name) != null) return;

    layers.Add(new Layer()
      {
        Name = name,
        Color = color,
        });
  }
# ---------- end c_script_2 ----------
c_script_3 = CSharpScript(
    directory=path,
    obj=c_script,
    Reference="E:\OneDrive - stu.zafu.edu.cn\PartTime\FFXIV\TakeMeEverywhere\TerritoryMesh\Newtonsoft.Json.dll")  # -> savedPath; inputs directory: String
# ---------- c_script_3: C# usings ----------
using System.IO;
using Newtonsoft.Json;
# ---------- c_script_3: C# ----------
    var dir = Path.GetDirectoryName(Grasshopper.Instances.ActiveCanvas.Document.FilePath);
    var name = new DirectoryInfo(directory).Name;
    var path = Path.Combine(dir, name + ".json");

    var str = JsonConvert.SerializeObject(obj, Formatting.Indented);
    File.WriteAllText(path, str);

    savedPath = path;
# ---------- end c_script_3 ----------
c_importobj = CSharpScript(filePath=c_script_2)  # inputs filePath: String
# ---------- c_importobj: C# usings ----------
using Rhino.FileIO;
using Rhino.DocObjects;
using System.IO;
# ---------- c_importobj: C# ----------
    var fileName = Path.GetFileNameWithoutExtension(filePath);

    var doc = Rhino.RhinoDoc.ActiveDoc;
    var layers = doc.Layers;

    var parentLayer = layers.FindName("Meshes");
    if (parentLayer == null)
    {
      parentLayer = layers[layers.Add(new Layer()
        {
          Name = "Meshes",
          })];
    }
    parentLayer.IsLocked = true;

    if (layers.FindName(fileName) != null) return;

    layers.SetCurrentLayerIndex(layers.Add(new Layer()
      {
        Name = fileName,
        ParentLayerId = parentLayer.Id,
        }), true);

    var readOptions = new FileReadOptions();
    readOptions.BatchMode = false;

    var option = new FileObjReadOptions(readOptions);
    option.MapYtoZ = true;

    FileObj.Read(filePath, doc, option);
# ---------- end c_importobj ----------
panel = Panel(c_script_3)
